# Grasshopper definition diff_growth_curve.gh (Grasshopper 1.0.7)

crv = Curve(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)
robo_comm_w_blend = GhPythonScript()  # -> out, points_to_move_to; inputs execute: Boolean, point_input: list of Point3d
# ---------- robo_comm_w_blend: Python ----------
import sys
import os

import robotic_drawing.robotic_drawing as rd
import robotic_drawing.utils as utils
rd.ROBOT_IP = '192.168.10.10'

import simple_ur_script as ur
import simple_comm as c

import Rhino.Geometry as rg
import math as m
print(sys.path)
os.chdir('C:\\Users\\a\\repos\\MAS-1920\\T1\\07_robotic_drawing_exercise')

def move_l_wb(plane_to, accel, vel, blend=0.):
    """
    Function that returns UR script for linear movement in tool-space.

    Args:
        plane_to: Rhino.Geometry Plane. A target plane for calculating pose (in UR base coordinate system)
        accel: tool accel in m/s^2
        vel: tool speed in m/s

    Returns:
        script: UR script
    """

    blend /= 1000.0

    # Check acceleration and velocity are non-negative and below a set limit
    accel = ur.MAX_ACCEL if (abs(accel) >ur.MAX_ACCEL) else abs(accel)
    vel = ur.MAX_VELOCITY if (abs(vel) > ur.MAX_VELOCITY) else abs(vel)

    _matrix = rg.Transform.PlaneToPlane(rg.Plane.WorldXY,plane_to)
    _axis_angle= utils.matrix_to_axis_angle(_matrix)
    # Create pose data
    _pose = [plane_to.OriginX/1000, plane_to.OriginY/1000, plane_to.OriginZ/1000,_axis_angle[0], _axis_angle[1], _axis_angle[2]]
    _pose_fmt = "p[" + ("%.4f,"*6)[:-1]+"]"
    _pose_fmt = _pose_fmt%tuple(_pose)
    # Format UR script
    script = 'movel(%s, a = %.2f, v = %.2F, r = %.3F)\n'%(_pose_fmt,accel,vel, blend)
    return script

points_to_move_to = point_input

list_of_planes = []

for p in points_to_move_to:
    plane = rg.Plane(p, rg.Vector3d.ZAxis)
    list_of_planes.append(plane)

robot_base = rd.load_robot_base_plane()

robo_planes = []

for way_plane in list_of_planes:
    robo_plane = rd.rhino_to_robot_space(way_plane,robot_base)
    robo_planes.append(robo_plane)

accel = 0.05
vel = .1
blend = 100

script = ''
for robo_plane in robo_planes:
    script += move_l_wb(robo_plane, accel, vel, blend)

if execute:
    script = c.concatenate_script(script)
    c.send_script(script, rd.ROBOT_IP)
else:
    script = c.concatenate_script(script)
    print script
# ---------- end robo_comm_w_blend ----------
