# Grasshopper definition grasshopper_setup.gh (Grasshopper 1.0.7)

X = UnitX(Factor=Slider(100, range=0..100))
Y = UnitY(Factor=Slider(100, range=0..100))
X_2 = UnitX(Factor=Slider(-50, range=-50..100))
pt = Point(Point(100, 100, 300))
move = Move(Geometry=pt, Motion=X_2)  # -> Geometry, Transform
cir = Circle(Plane=move.Geometry, Radius=Slider(50, range=0..100))
Z = UnitZ(Factor=Slider(280, range=0..1000))
python = GhPythonScript(
    radius=Slider(18, range=0..1000),
    layer_count=Slider(26, range=0..100),
    layer_height=Slider(2, range=0..10),
    div_pt_count=Slider(21, range=0..50),
    div_pt_offset=Slider(11, range=0..100),
    rotation_per_layer=Slider(85, range=0..180))  # -> out, polyl_list, polyl_pts_whole, spl_list; inputs layer_count: Int32
# ---------- python: Python ----------
__author__ = "a"
__version__ = "2019.10.03"

import Rhino.Geometry as rg
import math
import random

# generate tower/column/pen holder

# first circle 
start_pt = rg.Point3d(0.,0.,0.)
start_circle = rg.Circle(start_pt,radius)

# create  midpoint

mid_pt_list = []
base_circle_list = []
div_pt_list = []
vector_line_list = []
moved_div_pt_list = []
polyl_pts_whole = []
polyl_list = []
spl_list = []

for i in range(layer_count):
    
    polyl_pts = []
    
    mid_pt = rg.Point3d(0,0,layer_height * i)
    mid_pt_list.append(mid_pt)
    
    # create a circle
    
    base_circle = rg.Circle(mid_pt, radius)
    base_circle_list.append(base_circle)
    
    # rotate the circle
    
    rotation_xform = rg.Transform.Rotation(math.radians(rotation_per_layer) * i ,mid_pt)
    rg.Circle.Transform(base_circle, rotation_xform)
    
    # divide the circle
    
    div_params = rg.Curve.DivideByCount(base_circle.ToNurbsCurve(), div_pt_count * 2, True)
    
    for j, param in enumerate(div_params):
        div_pt = base_circle.ToNurbsCurve().PointAt(param)
        div_pt_list.append(div_pt)
        # move the circle's control pts
        # create vectors and visualize
        div_pt_vector = div_pt - mid_pt

        rg.Vector3d.Unitize(div_pt_vector)
        
        # move half of the pts with div_pt_offset
        div_pt_offset = random.random() * 10
        hori_sin_offset = math.sin(j * (2 *math.pi)/div_pt_count)
        vert_sin_offset = math.sin(i * (2 * math.pi)/layer_count)
        moved_div_pt = div_pt + (div_pt_vector * div_pt_offset * vert_sin_offset)
    
            
        polyl_pts.append(moved_div_pt)
            
    #create polyl and append to list
    polyl = rg.PolylineCurve(polyl_pts + [polyl_pts[0]])
    spline = rg.NurbsCurve.CreateInterpolatedCurve(polyl_pts + [polyl_pts[0]],3)
    polyl_list.append(polyl)
    spl_list.append(spline)
# ---------- end python ----------
neg = Negative(Value=Z)
move_2 = Move(Geometry=cir, Motion=neg)  # -> Geometry, Transform
button = Button()
move_3 = Move(Geometry=cir, Motion=neg)  # -> Geometry, Transform
Z_2 = UnitZ(Factor=Slider(298.5, range=0..1000))
neg_2 = Negative(Value=Z_2)

# ----
# text to pointlist
geo = Geometry([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])
number_slider = Slider(1, range=0..1)
Z_3 = UnitZ(Factor=5)

move_4 = Move(Geometry=geo, Motion=X)  # -> Geometry, Transform
move_5 = Move(Geometry=move_4.Geometry, Motion=Y)  # -> Geometry, Transform

area = Area(Geometry=move_5.Geometry)  # -> Area, Centroid
pdecon = Deconstruct(Point=area.Centroid)  # -> XComponent, YComponent, ZComponent
sort = SortList(Keys=pdecon.XComponent, ValuesA=move_5.Geometry)  # -> Keys, ValuesA
explode = Explode(Curve=graft(sort.ValuesA), Recursive=True)  # -> Segments, Vertices
divlength = DivideLength(Curve=explode.Segments, Length=Slider(0.2, range=0..1))  # -> Points, Tangents, Parameters
trim = TrimTree(Tree=divlength.Points, Depth=1)
item = ListItem(List=trim, Index=0, Wrap=True)
move_6 = Move(Geometry=item, Motion=Z_3)  # -> Geometry, Transform
merge = Merge(Data1=trim, Data2=move_6.Geometry)
pline = PolyLine(Vertices=flatten(merge), Closed=False)
pt_2 = Point(flatten(merge))

move_7 = Move(Geometry=pt_2, Motion=neg_2)  # -> Geometry, Transform
python_2 = GhPythonScript(
    curve_like_object=pline,
    execute=Toggle(False),
    point_input=move_3.Geometry,
    divide_segment_length=Slider(3, range=0..50))  # -> out, points_to_move_to; inputs curve_like_object: Curve, execute: Boolean, point_input: list of Point3d; disabled
# ---------- python_2: Python ----------
import sys
sys.path.append('C:\Users\a\repos\MAS-1920\T1\07_robotic_drawing_exercise\robotic_drawing')

import robotic_drawing.robotic_drawing as rd
import robotic_drawing.utils as utils
rd.ROBOT_IP = '192.168.10.10'

import simple_ur_script as ur
import simple_comm as c

import Rhino.Geometry as rg
import math as m


#print(curve_like_object)
#div_params = rg.Curve.DivideByLength(curve_like_object, divide_segment_length, True)

points_to_move_to = point_input

for param in div_params:
    point = curve_like_object.PointAt(param)
    points_to_move_to.append(point)

#print(points_to_move_to)

list_of_planes = []

for p in points_to_move_to:
    plane = rg.Plane(p, rg.Vector3d.ZAxis)
    list_of_planes.append(plane)

##rd.set_robot_base_plane()

robot_base = rd.load_robot_base_plane()

move_to = rg.Point3d(300.0,60.0,200.0)
rd.move_robot_vertical(move_to)

#zero_plane = rg.Plane(rg.Point3d(20,20,125),rg.Vector3d.ZAxis)
#
#plane_1 = rg.Plane(rg.Point3d(400.0,20.0,125),rg.Vector3d.ZAxis)
#plane_2 = rg.Plane(rg.Point3d(400.0,277,125),rg.Vector3d.ZAxis)
#plane_3 = rg.Plane(rg.Point3d(20,277,125),rg.Vector3d.ZAxis)

#way_planes = [zero_plane, plane_1, plane_2, plane_3 ]


robo_planes = []

for way_plane in list_of_planes:
    robo_plane = rd.rhino_to_robot_space(way_plane,robot_base)
    robo_planes.append(robo_plane)


robo_planes *= 10

accel = 0.05
vel = .1
blend = 100

script = ''
for robo_plane in robo_planes:
    script += ur.move_l(robo_plane, accel, vel)

if execute:
    script = c.concatenate_script(script)
    c.send_script(script, rd.ROBOT_IP)
else:
    script = c.concatenate_script(script)
    print script


#import random as r
#way_planes = []
#for i in range(100):
#    x = r.randint(50,370)
#    y = r.randint(50,247)
#    way_plane = rg.Plane(rg.Point3d(x,y,0.1),rg.Vector3d.ZAxis)
#    way_planes.append(way_plane)
#    way_plane = rg.Plane(rg.Point3d(x,y,100),rg.Vector3d.ZAxis)
#    way_planes.append(way_plane)



























#

#



#home_pose = [0.0,-90.0,0.0,-90.0,0.0,0.0]
#home_pose = [m.radians(n) for n in home_pose]
#script = ur.move_j(home_pose,0.02,0.1)
#c.send_script(script, rd.ROBOT_IP)
# ---------- end python_2 ----------
pt_3 = Point(python_2.points_to_move_to)
