# Grasshopper definition 191003_MAS_T1_GHPython_master_file.gh (Grasshopper 1.0.7)
# plug-ins: Bifocals

# ---- group: Parameters
number_slider = Slider(44, range=0..100)
layer_height = Slider(1, range=0..10)
layer_count = Slider(84, range=0..100)
div_pt_count = Slider(11, range=0..100)
rotation_per_layer = Slider(0.3, range=0..5)

# ---- group: Graph controlling scaling over height with sine cure
range = Range(Domain=Domain(0, 1), Steps=expr("x-1", layer_count))
graph = GraphMapper(
    range,
    x0=0,
    x1=1,
    y0=0,
    y1=1,
    container_name="Sine",
    Equation_px=[0, 0.9811940789],
    Equation_py=[0.381778419, 0.7779895067])

# ---- group: Graph controlling point offset within a layer
range_2 = Range(Domain=Domain(0, 1), Steps=expr("x-1", div_pt_count))
graph_2 = GraphMapper(range_2, x0=0, x1=1, y0=0, y1=1, container_name="Sine", Equation_px=[0, 0.7340943813], Equation_py=[0, 0.6565697789])
dom = ConstructDomain(DomainStart=Slider(0, range=0..100), DomainEnd=Slider(41, range=0..100))

# ----
multiplication = Multiplication(A=div_pt_count, B=2)

# ---- group: Create circle
pt = ConstructPoint(XCoordinate=0, YCoordinate=0, ZCoordinate=0)
cir = Circle(Plane=pt, Radius=number_slider)

# ---- group: Copy circle up and rotate
series = Series(Start=0, Step=layer_height, Count=layer_count)
Z = UnitZ(Factor=series)
move = Move(Geometry=cir, Motion=Z)  # -> Geometry, Transform
series_2 = Series(Start=0, Step=rotation_per_layer, Count=layer_count)
rotate = Rotate(Geometry=move.Geometry, Angle=degrees(series_2), Plane=PlaneXY(0, 0, 0))  # -> Geometry, Transform

# ----
divide = DivideCurve(Curve=rotate.Geometry, Count=multiplication, Kinks=False)  # -> Points, Tangents, Parameters
area = Area(Geometry=rotate.Geometry)  # -> Area, Centroid
python = GhPythonScript(
    radius=number_slider,
    layer_count=layer_count,
    layer_height=layer_height,
    div_pt_count=div_pt_count,
    div_pt_offset=Slider(15, range=0..100),
    rotation_per_layer=rotation_per_layer)  # -> out, moved_div_pt_list, polyline_list; inputs radius: Int32, layer_count: Int32
# ---------- python: Python ----------
__author__ = "joburger"
__version__ = "2019.10.03"

import Rhino.Geometry as rg
import math

start_point = rg.Point3d(0,0,0)
start_circle = rg.Circle(start_point, radius)

# script which generates a tower/column/pen holder

# create empty lists

moved_div_pt_list = []
polyline_list = []

# create a midpoint
for i in range(layer_count):
    polyline_points = []
    print(i)
    mid_pt = rg.Point3d(0,0, layer_height * i)
    # create a circle
    base_circle = rg.Circle(mid_pt, radius)
    # rotate the circle
    rotation_xform = rg.Transform.Rotation(math.radians(rotation_per_layer*i), mid_pt)
    rg.Circle.Transform(base_circle, rotation_xform)
    # divide the circle
    circle_curve = rg.Circle.ToNurbsCurve(base_circle)
    div_params = rg.Curve.DivideByCount(circle_curve, div_pt_count * 2, True)
    for j, param in enumerate(div_params):
        print("j", j)
        print("param", param)
        div_pt = rg.Curve.PointAt(circle_curve, param)
        #div_pt_list.append(div_pt)
        # move the circle's control points
        # create vectors and visualize
        div_pt_vector = div_pt - mid_pt
        vector_line = rg.Line(mid_pt, div_pt_vector)
        rg.Vector3d.Unitize(div_pt_vector)
        
        # if even: move points with divptoffset
        if j % 2 == 0:
            # create a horizontal offset based on sine curves
            hor_sin_offset = math.sin(j* (4*math.pi)/div_pt_count)
            # create a vertical offset based on sine curves
            vert_sin_offset = math.sin(i * (2*math.pi)/layer_count)
            moved_div_pt = div_pt + (div_pt_vector * div_pt_offset * vert_sin_offset * hor_sin_offset)
        # if uneven: do not move
        else:
            moved_div_pt = div_pt
        
        moved_div_pt_list.append(moved_div_pt)
        polyline_points.append(moved_div_pt)
        
    # create polylines and append to list
    polyline = rg.PolylineCurve(polyline_points + [polyline_points[0]])
    polyline_list.append(polyline)
# ---------- end python ----------

# ---- group: Create vector and move div_pts / mid_pt
graft = GraftTree(Tree=area.Centroid, IncludeEmptyLists=True, IncludeNullItems=True)

# ---- group: Create vector and move div_pts / points_before_moving
cull = CullPattern(List=divide.Points, CullPattern=[False, True])

# ---- group: Create vector and move div_pts / non_moved_pts
cull_2 = CullPattern(List=divide.Points, CullPattern=[True, False])

# ---- group: Create vector and move div_pts
vec2pt = Vector2Pt(PointA=divide.Points, PointB=graft, Unitize=False)  # -> Vector, Length
unit = UnitVector(Vector=vec2pt.Vector)
remap = RemapNumbers(Value=graph_2, Source=Domain(0, 1), Target=dom)  # -> Mapped, Clipped

# ---- group: Create vector and move div_pts / moved_pts_vect
cull_3 = CullPattern(List=unit, CullPattern=[False, True])

# ---- group: Create vector and move div_pts (continued)
multiplication_2 = Multiplication(A=cull_3, B=remap.Mapped)

# ---- group: Create vector and move div_pts / moved_pts
move_2 = Move(Geometry=cull, Motion=multiplication_2)  # -> Geometry, Transform

# ---- group: Weave two lists of moved and non-moved points back together
weave = Weave(Pattern=[0, 1], Stream0=cull_2, Stream1=move_2.Geometry, NullGaps=False)

# ---- group: Scale the layers using the sine curve
scale = Scale(Geometry=weave, Center=graft, Factor=graft(graph))  # -> Geometry, Transform

# ---- group: Output / polyline_per_layer
pline = PolyLine(Vertices=scale.Geometry, Closed=True)

# ---- group: Output / pts_per_layer
pt_2 = Point(scale.Geometry)

# ---- group: Output
flatten = FlattenTree(Tree=pt_2, Path="{0}")
fillet = Fillet(Curve=pline, Radius=Slider(4, range=0..100))

# ---- group: Output / flattened_points
pt_3 = Point(flatten)

# ---- group: Output / loft_end_result
loft = Loft(Curves=flatten(fillet), Options={Adjust=False, Closed=False, LoftEnds=0, LoftSimp=0, LoftType=0, Rebuild=10, Refit=0.01})

# ---- group: Loft
brep = Brep(loft)

# ---- group: Polylines per layer
crv = Curve(fillet)

# ---- group: Points per layer
pt_4 = Point(pt_2)
