# Grasshopper definition tutorial_01.gh (Grasshopper 1.0.7)
# plug-ins: Bifocals

number_slider = Slider(47, range=0..180)
number_slider_2 = Slider(12, range=0..100)
number_slider_3 = Slider(18, range=0..1000)
number_slider_4 = Slider(10, range=0..50)
division = Division(A=50, B=number_slider_2)
python = GhPythonScript(
    radius=number_slider_3,
    layer_count=number_slider_2,
    layer_height=division,
    div_pt_count=number_slider_4,
    div_pt_offset=Slider(0, range=0..100),
    rotation_per_layer=number_slider)  # -> out, polyl_list, polyl_pts_whole, spl_list; inputs layer_count: Int32
# ---------- python: Python ----------
__author__ = "a"
__version__ = "2019.10.03"

import Rhino.Geometry as rg
import math
import random

# generate tower/column/pen holder

# first circle 
start_pt = rg.Point3d(0.,0.,0.)
start_circle = rg.Circle(start_pt,radius)

# create  midpoint

mid_pt_list = []
base_circle_list = []
div_pt_list = []
vector_line_list = []
moved_div_pt_list = []
polyl_pts_whole = []
polyl_list = []
spl_list = []

for i in range(layer_count):
    
    polyl_pts = []
    
    mid_pt = rg.Point3d(0,0,layer_height * i)
    mid_pt_list.append(mid_pt)
    
    # create a circle
    
    base_circle = rg.Circle(mid_pt, radius)
    base_circle_list.append(base_circle)
    
    # rotate the circle
    
    rotation_xform = rg.Transform.Rotation(math.radians(rotation_per_layer) * i ,mid_pt)
    rg.Circle.Transform(base_circle, rotation_xform)
    
    # divide the circle
    
    div_params = rg.Curve.DivideByCount(base_circle.ToNurbsCurve(), div_pt_count * 2, True)
    
    for j, param in enumerate(div_params):
        div_pt = base_circle.ToNurbsCurve().PointAt(param)
        div_pt_list.append(div_pt)
        # move the circle's control pts
        # create vectors and visualize
        div_pt_vector = div_pt - mid_pt

        rg.Vector3d.Unitize(div_pt_vector)
        
        # move half of the pts with div_pt_offset
        div_pt_offset = random.random() * 10
        hori_sin_offset = math.sin(-j * (2 *math.pi)/div_pt_count)
        vert_sin_offset = math.sin(-i * (2 * math.pi)/layer_count)
        moved_div_pt = div_pt + (div_pt_vector * div_pt_offset * vert_sin_offset)
    
            
        polyl_pts.append(moved_div_pt)
            
    #create polyl and append to list
    polyl = rg.PolylineCurve(polyl_pts + [polyl_pts[0]])
    spline = rg.NurbsCurve.CreateInterpolatedCurve(polyl_pts + [polyl_pts[0]],3)
    polyl_list.append(polyl)
    spl_list.append(spline)
# ---------- end python ----------

pt = ConstructPoint(XCoordinate=0, YCoordinate=0, ZCoordinate=0)
series = Series(Start=0, Step=Slider(2, range=0..10), Count=number_slider_2)
cir = Circle(Plane=pt, Radius=number_slider_3)
Z = UnitZ(Factor=series)
move = Move(Geometry=cir, Motion=Z)  # -> Geometry, Transform
series_2 = Series(Start=0, Step=number_slider, Count=number_slider_2)
rotate = Rotate(Geometry=move.Geometry, Angle=degrees(series_2), Plane=PlaneXY(0, 0, 0))  # -> Geometry, Transform
area = Area(Geometry=rotate.Geometry)  # -> Area, graft(Centroid)
divide = DivideCurve(Curve=rotate.Geometry, Count=number_slider_4, Kinks=False)  # -> Points, Tangents, Parameters
panel = Panel("""False
True""")
vec2pt = Vector2Pt(PointA=divide.Points, PointB=area.Centroid, Unitize=False)  # -> Vector, Length
cull = CullPattern(List=divide.Points, CullPattern=invert(panel))
cull_2 = CullPattern(List=divide.Points, CullPattern=panel)
unit = UnitVector(Vector=vec2pt.Vector)
cull_3 = CullPattern(List=unit, CullPattern=invert(panel))
cull_4 = CullPattern(List=unit, CullPattern=panel)
vdis = VectorDisplay(Anchor=area.Centroid, Vector=unit)
panel_2 = Panel("""True
False""")
multiplication = Multiplication(A=cull_4, B=Slider(-3, range=-100..100))
move_2 = Move(Geometry=cull_2, Motion=multiplication)  # -> Geometry, Transform
weave = Weave(Pattern=panel, Stream0=multiplication, Stream1=cull_3, NullGaps=False)
expression = Expression(x=series_2, y=Slider(0.00225, range=0..1), Expression="(x+1)*y")
scale = Scale(Geometry=cull, Center=area.Centroid, Factor=expression)  # -> Geometry, Transform
weave_2 = Weave(Pattern=panel, Stream0=move_2.Geometry, Stream1=scale.Geometry, NullGaps=False)
vdis_2 = VectorDisplay(Anchor=weave_2, Vector=weave)
pline = PolyLine(Vertices=weave_2, Closed=True)
fillet = Fillet(Curve=pline, Radius=Slider(20, range=0..100))
loft = Loft(Curves=flatten(fillet), Options={Adjust=False, Closed=False, LoftEnds=0, LoftSimp=0, LoftType=0, Rebuild=10, Refit=0.01})

loft_2 = Loft(Curves=python.spl_list, Options={Adjust=False, Closed=False, LoftEnds=0, LoftSimp=0, LoftType=0, Rebuild=10, Refit=0.01})
